# Dynamo graph delete_km_documentation.dyn (Dynamo 3.0.0.0)
# author: Dynamo Script Generator
# Deletes all KM documentation elements created by create_km_documentation script (sheets, views, schedules with KM_AUTO_ prefix)

# group: KM Documentation Deleter
# Deletes all elements created by the create_km_documentation script.
# Searches for elements with 'KM_AUTO_' prefix and removes them.
# Deletes in order:
# 1. Viewports
# 2. Schedule sheet instances
# 3. Schedules
# 4. Views (3D, plans, sections)
# 5. Sheets
km_documentation_deleter = Python()  # CPython3
# ---------- km_documentation_deleter.python (154 lines) ----------
# -*- coding: utf-8 -*-
# Dynamo Script for Revit 2025 - KM Documentation Deleter
# Removes all elements with KM_AUTO_ prefix

import clr
clr.AddReference('RevitAPI')
clr.AddReference('RevitAPIUI')
clr.AddReference('RevitServices')
clr.AddReference('RevitNodes')

from RevitServices.Persistence import DocumentManager
from RevitServices.Transactions import TransactionManager

from Autodesk.Revit.DB import *
from Autodesk.Revit.UI import *

import Revit
clr.ImportExtensions(Revit.Elements)
clr.ImportExtensions(Revit.GeometryConversion)

# Configuration - must match the creation script
PREFIX = "KM_AUTO_"

doc = DocumentManager.Instance.CurrentDBDocument
uidoc = DocumentManager.Instance.CurrentUIApplication.ActiveUIDocument

def get_elements_with_prefix():
    """Find all elements with the specified prefix"""
    elements_to_delete = []
    
    # 1. Find sheets with prefix
    sheets = FilteredElementCollector(doc).OfClass(ViewSheet).ToElements()
    for sheet in sheets:
        if sheet.Name.startswith(PREFIX) or sheet.SheetNumber.startswith(PREFIX):
            elements_to_delete.append(sheet)
    
    # 2. Find views with prefix (3D, plans, sections)
    views = FilteredElementCollector(doc).OfClass(View).ToElements()
    for view in views:
        try:
            if view.Name.startswith(PREFIX):
                # Don't delete if it's a template
                if not view.IsTemplate:
                    elements_to_delete.append(view)
        except:
            pass
    
    # 3. Find schedules with prefix
    schedules = FilteredElementCollector(doc).OfClass(ViewSchedule).ToElements()
    for schedule in schedules:
        try:
            if schedule.Name.startswith(PREFIX):
                elements_to_delete.append(schedule)
        except:
            pass
    
    # 4. Find schedule sheet instances (placed schedules on sheets)
    schedule_instances = FilteredElementCollector(doc).OfClass(ScheduleSheetInstance).ToElements()
    for si in schedule_instances:
        try:
            schedule = doc.GetElement(si.ScheduleId)
            if schedule and schedule.Name.startswith(PREFIX):
                elements_to_delete.append(si)
        except:
            pass
    
    # 5. Find viewports on sheets with prefix
    viewports = FilteredElementCollector(doc).OfClass(Viewport).ToElements()
    for vp in viewports:
        try:
            sheet = doc.GetElement(vp.SheetId)
            if sheet and (sheet.Name.startswith(PREFIX) or sheet.SheetNumber.startswith(PREFIX)):
                elements_to_delete.append(vp)
        except:
            pass
    
    return elements_to_delete

def delete_elements(elements):
    """Delete elements and return count of deleted"""
    deleted_count = 0
    errors = []
    
    # Sort elements to delete viewports and schedule instances first
    # Then views and schedules, then sheets
    def get_priority(elem):
        if isinstance(elem, Viewport):
            return 0
        elif isinstance(elem, ScheduleSheetInstance):
            return 1
        elif isinstance(elem, ViewSchedule):
            return 2
        elif isinstance(elem, View) and not isinstance(elem, ViewSheet):
            return 3
        elif isinstance(elem, ViewSheet):
            return 4
        return 5
    
    sorted_elements = sorted(elements, key=get_priority)
    
    for elem in sorted_elements:
        try:
            elem_name = ""
            try:
                if hasattr(elem, 'Name'):
                    elem_name = elem.Name
                elif hasattr(elem, 'SheetNumber'):
                    elem_name = elem.SheetNumber
            except:
                elem_name = str(elem.Id.IntegerValue)
            
            doc.Delete(elem.Id)
            deleted_count += 1
        except Exception as e:
            errors.append(f"{elem_name}: {str(e)}")
    
    return deleted_count, errors

# Main execution
TransactionManager.Instance.EnsureInTransaction(doc)

log_messages = []
deleted_count = 0
errors = []

try:
    # Find elements with prefix
    elements_to_delete = get_elements_with_prefix()
    log_messages.append(f"Found {len(elements_to_delete)} elements with prefix '{PREFIX}'")
    
    if elements_to_delete:
        # Delete elements
        deleted_count, errors = delete_elements(elements_to_delete)
        log_messages.append(f"Deleted {deleted_count} elements")
        
        if errors:
            log_messages.append(f"Errors during deletion: {len(errors)}")
            for err in errors[:10]:  # Show first 10 errors
                log_messages.append(f"  - {err}")
    else:
        log_messages.append("No elements found to delete")
        
except Exception as e:
    log_messages.append(f"Error: {str(e)}")

TransactionManager.Instance.TransactionTaskDone()

# Output
OUT = {
    "deleted_count": deleted_count,
    "prefix": PREFIX,
    "log": log_messages,
    "errors": errors
}
# ----------------------------------------

watch_result = Watch(km_documentation_deleter)
