# Dynamo graph Ведомость_изменений_Подсчет_участков_D2_v1_0.dyn "ENECA-ALL-Ведомость изменений_Подсчет участков-D2-v1.0" (Dynamo 3.0.3.7597)
# Нужно скопировать спеку из файла задачи, и там же указания как пользоваться https://yougile.com/team/09022a601c33/#HEL-225

file_path = Filename(".\ENECA-ALL-Ведомость изменений_Подсчет участков-D2-v1.0.py")
file_from_path = FileObject(path=file_path)
readText = FileSystem.ReadText(file=file_from_path)
переключатель = BoolSelector(true)
python_script_from_string = PythonStringNode(script=readText, IN[0]=переключатель)  # IronPython2
python_script = Python()  # IronPython2; unwired: IN[0]
# ---------- python_script.python (72 lines) ----------
#! /usr/bin/env python
# -*- coding: utf-8 -*-

import itertools
import clr
clr.AddReference('ProtoGeometry')
from Autodesk.DesignScript.Geometry import *
#Введенные в этом узле данные сохраняется в виде списка в переменных IN.

clr .AddReference ("RevitAPI")
import Autodesk 
from Autodesk .Revit .DB import *

clr.AddReference('RevitNodes')
import Revit
clr.ImportExtensions(Revit.Elements)

clr.AddReference('RevitServices')
import RevitServices
from RevitServices.Persistence import DocumentManager
from RevitServices.Transactions import TransactionManager

################____________Analytics_script_______################_____Start
import sys

sys.path.append(r'C:\Program Files (x86)\IronPython 2.7\Lib')
#импортируем файлы для работы с операционной системой(запись в файл и его сохранение)
import os
#импортируем файлы для работы с текущим временем
import datetime
############_____________Name___________################
ScriptName = "ENECA-ALL-Ведомость изменений_Подсчет участков"

doc = DocumentManager.Instance.CurrentDBDocument
uiapp = DocumentManager.Instance.CurrentUIApplication
uidoc = DocumentManager.Instance.CurrentUIDocument
app = uiapp.Application

try:
	openFile = open(r"R:\1 - Проекты\- Координация\- Аналитика\scripts-LOG.txt", 'a+')

	dtn = datetime.datetime.now()
	dtn = str(dtn)#переводим в строчный тип
	datatimenow = dtn.split(':')[0]+':'+dtn.split(':')[1]
	datatimenow = str(datatimenow)#переводим в строчный тип
	project = doc.Title

	Line = """\n{}\t{}\t{}\t{}""".format(ScriptName, datatimenow, app.Username, project)
	#Записываем и указываем точную кодировку для записываемой информации
	stringLine = openFile.write(Line.encode('utf-8'))
	#закрываем, так же можем использовать with или try--finally
	openFile.close()
except:
	
	openFile = open(r"R:\1 - Проекты\- Координация\- Аналитика\scripts-LOG-Reserve.txt", 'a+')

	dtn = datetime.datetime.now()
	dtn = str(dtn)#переводим в строчный тип
	datatimenow = dtn.split(':')[0]+':'+dtn.split(':')[1]
	datatimenow = str(datatimenow)#переводим в строчный тип
	project = doc.Title

	Line = """\n{}\t{}\t{}\t{}""".format(ScriptName, datatimenow, app.Username, project)
	#Записываем и указываем точную кодировку для записываемой информации
	stringLine = openFile.write(Line.encode('utf-8'))
	#закрываем, так же можем использовать with или try--finally
	openFile.close()

######------------------------------------#####

	
OUT = 0
# ----------------------------------------
