# Dynamo graph create_km_documentation.dyn (Dynamo 3.0.0.0)
# author: Dynamo Script Generator
# KM Documentation Generator - loads logic from km_documentation_logic.py

# group: KM Documentation Generator
# KM Documentation Generator (Loader)
# Main logic is in: km_documentation_logic.py
# Edit the .py file directly in any IDE!
# Changes take effect on next run (no need to edit .dyn).
# Creates:
# - Title sheet (with title block)
# - 4 building elevation views (N, S, E, W)
# - Sheets for each unique TYPE SIZE with:
#   - Plan view
#   - Section views (X and Y)
#   - 3D view
#   - Schedule (filtered by type!)
km_documentation_generator = Python()  # CPython3
# ---------- km_documentation_generator.python (37 lines) ----------
# Dynamo Script for Revit 2025 - KM Documentation Generator
# This is a LOADER - main logic is in km_documentation_logic.py

import clr
import sys
import os

# Path to script directory
script_dir = r"C:\Users\feduloves\Documents\web\rhino_cpsk\industrial_building\dyn_scripts"

# Add to sys.path if not already there
if script_dir not in sys.path:
    sys.path.insert(0, script_dir)

try:
    # Force reload if module was already imported (for development)
    if 'km_documentation_logic' in sys.modules:
        del sys.modules['km_documentation_logic']

    # Import and run
    import km_documentation_logic
    OUT = km_documentation_logic.run()

except Exception as e:
    import traceback
    error_msg = "LOADER ERROR: " + str(e) + "\n" + traceback.format_exc()
    error_msg += "\nScript dir: " + str(script_dir)

    # Try to show error dialog
    try:
        clr.AddReference('RevitAPIUI')
        from Autodesk.Revit.UI import TaskDialog
        TaskDialog.Show("Loader Error", error_msg[:2000])
    except:
        pass

    OUT = error_msg
# ----------------------------------------

watch_result = Watch(km_documentation_generator)
