# Dynamo graph export_to_pdf.dyn (Dynamo 3.0.0.0)
# author: Dynamo Script Generator
# Exports all KM_AUTO_ prefixed sheets to PDF files

# group: Export KM Sheets to PDF
# Exports all KM_AUTO_ sheets to single PDF file.
# 1. Shows folder selection dialog
# 2. Combines all sheets into KM_Documentation.pdf
# 3. Opens folder in Explorer after export
# Run create_km_documentation.dyn first!
export_to_pdf = Python()  # CPython3
# ---------- export_to_pdf.python (163 lines) ----------
# Dynamo Script for Revit 2025 - Export KM Sheets to PDF
# Exports all sheets with KM_AUTO_ prefix to PDF files
# Shows folder selection dialog and opens folder after export

import clr
import os
import subprocess

try:
    clr.AddReference('RevitAPI')
    clr.AddReference('RevitAPIUI')
    clr.AddReference('RevitServices')
    clr.AddReference('RevitNodes')
    clr.AddReference('System.Windows.Forms')
    
    from RevitServices.Persistence import DocumentManager
    from RevitServices.Transactions import TransactionManager
    
    from Autodesk.Revit.DB import FilteredElementCollector, ViewSheet
    from Autodesk.Revit.DB import PDFExportOptions, ExportPaperFormat
    from Autodesk.Revit.DB import ElementId
    from Autodesk.Revit.UI import TaskDialog
    
    from System.Collections.Generic import List
    from System.Windows.Forms import FolderBrowserDialog, DialogResult
    
    # Configuration
    PREFIX = "KM_AUTO_"
    
    doc = DocumentManager.Instance.CurrentDBDocument
    
    def get_prefixed_sheets():
        """Get all sheets with KM_AUTO_ prefix"""
        sheets = []
        collector = FilteredElementCollector(doc).OfClass(ViewSheet).ToElements()
        for sheet in collector:
            try:
                name = sheet.Name
                num = sheet.SheetNumber
                if name.startswith(PREFIX) or num.startswith(PREFIX):
                    sheets.append(sheet)
            except:
                pass
        return sheets
    
    def select_output_folder():
        """Show folder selection dialog"""
        # Get default path (Revit file folder or Desktop)
        default_path = os.path.expanduser("~")
        try:
            doc_path = doc.PathName
            if doc_path:
                default_path = os.path.dirname(doc_path)
        except:
            pass
        
        dialog = FolderBrowserDialog()
        dialog.Description = "Select folder to save PDF files"
        dialog.SelectedPath = default_path
        dialog.ShowNewFolderButton = True
        
        if dialog.ShowDialog() == DialogResult.OK:
            return dialog.SelectedPath
        return None
    
    def open_folder(folder_path):
        """Open folder in Windows Explorer"""
        try:
            os.startfile(folder_path)
        except:
            try:
                subprocess.Popen(['explorer', folder_path])
            except:
                pass
    
    def export_sheets_to_pdf(sheets, output_folder):
        """Export all sheets to single combined PDF"""
        errors = []
        output_file = "KM_Documentation.pdf"
        
        try:
            # Sort sheets by number
            sorted_sheets = sorted(sheets, key=lambda s: s.SheetNumber)
            
            # Collect all sheet IDs
            view_ids = List[ElementId]()
            for sheet in sorted_sheets:
                view_ids.Add(sheet.Id)
            
            # Create PDF export options
            pdf_options = PDFExportOptions()
            pdf_options.PaperFormat = ExportPaperFormat.Default
            pdf_options.Combine = True
            pdf_options.FileName = "KM_Documentation"
            
            # Export all sheets at once
            result = doc.Export(output_folder, view_ids, pdf_options)
            
            if result:
                return [output_file], errors, len(sorted_sheets)
            else:
                errors.append("Export failed")
                return [], errors, 0
                
        except Exception as ex:
            errors.append("Export error: " + str(ex))
            return [], errors, 0
    
    # Main execution
    sheets = get_prefixed_sheets()
    
    if len(sheets) == 0:
        result_text = "No sheets with prefix '" + PREFIX + "' found!\n\nRun create_km_documentation.dyn first."
        TaskDialog.Show("PDF Export", result_text)
        OUT = result_text
    else:
        # Show folder selection dialog
        output_folder = select_output_folder()
        
        if output_folder is None:
            result_text = "Export cancelled - no folder selected."
            TaskDialog.Show("PDF Export", result_text)
            OUT = result_text
        else:
            TransactionManager.Instance.EnsureInTransaction(doc)
            exported, errors, sheet_count = export_sheets_to_pdf(sheets, output_folder)
            TransactionManager.Instance.TransactionTaskDone()
            
            # Build result message
            lines = []
            if len(exported) > 0:
                lines.append("PDF EXPORT COMPLETE")
                lines.append("")
                lines.append("File: " + exported[0])
                lines.append("Folder: " + output_folder)
                lines.append("")
                lines.append("Sheets in PDF: " + str(sheet_count))
            else:
                lines.append("PDF EXPORT FAILED")
            
            if len(errors) > 0:
                lines.append("")
                lines.append("Errors:")
                for e in errors:
                    lines.append("  " + e)
            
            result_text = "\n".join(lines)
            TaskDialog.Show("PDF Export", result_text)
            
            # Open folder in Explorer
            if len(exported) > 0:
                open_folder(output_folder)
            
            OUT = result_text

except Exception as e:
    import traceback
    error_msg = "ERROR: " + str(e) + "\n" + traceback.format_exc()
    try:
        TaskDialog.Show("PDF Export Error", error_msg)
    except:
        pass
    OUT = error_msg
# ----------------------------------------

watch_result = Watch(export_to_pdf)
