# Dynamo graph get_viewport_coords.dyn (Dynamo 3.0.0.0)
# author: Dynamo Script Generator
# Get viewport coordinates

# group: KM Documentation Generator
# KM Documentation Generator (Loader)
# Main logic is in: km_documentation_logic.py
# Edit the .py file directly in any IDE!
# Changes take effect on next run (no need to edit .dyn).
# Creates:
# - Title sheet (with title block)
# - 4 building elevation views (N, S, E, W)
# - Sheets for each unique TYPE SIZE with:
#   - Plan view
#   - Section views (X and Y)
#   - 3D view
#   - Schedule (filtered by type!)
km_documentation_generator = Python()  # CPython3
# ---------- km_documentation_generator.python (151 lines) ----------
import clr
clr.AddReference('RevitAPI')
clr.AddReference('RevitAPIUI')
clr.AddReference('RevitServices')

from RevitServices.Persistence import DocumentManager
from Autodesk.Revit.DB import FilteredElementCollector, Viewport, BuiltInCategory, FamilyInstance

clr.AddReference('System.Windows.Forms')
clr.AddReference('System.Drawing')
from System.Windows.Forms import Form, TextBox, ScrollBars, DockStyle
from System.Drawing import Size, Font

def show_dialog(title, text):
    form = Form()
    form.Text = title
    form.Size = Size(700, 500)
    form.StartPosition = 4
    textbox = TextBox()
    textbox.Multiline = True
    textbox.ScrollBars = ScrollBars.Both
    textbox.Dock = DockStyle.Fill
    textbox.Font = Font("Consolas", 10)
    textbox.Text = text
    textbox.ReadOnly = True
    form.Controls.Add(textbox)
    form.ShowDialog()

doc = DocumentManager.Instance.CurrentDBDocument
uidoc = DocumentManager.Instance.CurrentUIApplication.ActiveUIDocument

result = []
result.append("=== SELECTED ELEMENT INFO ===")
result.append("")

selection = list(uidoc.Selection.GetElementIds())

if len(selection) == 0:
    result.append("No elements selected!")
    result.append("")
    result.append("Select either:")
    result.append("  - A VIEWPORT to get its position")
    result.append("  - The TITLE BLOCK to get frame bounds")
else:
    for elem_id in selection:
        elem = doc.GetElement(elem_id)
        elem_type = str(type(elem).__name__)
        result.append("Element Type: " + elem_type)
        result.append("Element ID: " + str(elem_id.IntegerValue))
        result.append("")
        
        # Get active view (sheet)
        active_view = uidoc.ActiveView
        
        if isinstance(elem, Viewport):
            result.append("=== VIEWPORT ===")
            center = elem.GetBoxCenter()
            result.append("Center: (" + str(round(center.X * 304.8)) + ", " + str(round(center.Y * 304.8)) + ") mm")
            
            outline = elem.GetBoxOutline()
            if outline:
                result.append("Box Min: (" + str(round(outline.MinimumPoint.X * 304.8)) + ", " + str(round(outline.MinimumPoint.Y * 304.8)) + ") mm")
                result.append("Box Max: (" + str(round(outline.MaximumPoint.X * 304.8)) + ", " + str(round(outline.MaximumPoint.Y * 304.8)) + ") mm")
        
        elif isinstance(elem, FamilyInstance):
            # Check if it's a title block
            cat = elem.Category
            if cat and cat.Id.IntegerValue == int(BuiltInCategory.OST_TitleBlocks):
                result.append("=== TITLE BLOCK ===")
                
                # Get bounding box
                bb = elem.get_BoundingBox(active_view)
                if bb:
                    min_x = round(bb.Min.X * 304.8)
                    min_y = round(bb.Min.Y * 304.8)
                    max_x = round(bb.Max.X * 304.8)
                    max_y = round(bb.Max.Y * 304.8)
                    width = max_x - min_x
                    height = max_y - min_y
                    
                    result.append("BBox Min: (" + str(min_x) + ", " + str(min_y) + ") mm")
                    result.append("BBox Max: (" + str(max_x) + ", " + str(max_y) + ") mm")
                    result.append("Size: " + str(width) + " x " + str(height) + " mm")
                    result.append("")
                    
                    # Calculate workable area (GOST margins)
                    margin_left = 20
                    margin_right = 5
                    margin_top = 5
                    margin_bottom = 55
                    
                    work_left = min_x + margin_left
                    work_right = max_x - margin_right
                    work_bottom = min_y + margin_bottom
                    work_top = max_y - margin_top
                    work_w = work_right - work_left
                    work_h = work_top - work_bottom
                    
                    result.append("=== WORKABLE AREA (with GOST margins) ===")
                    result.append("Left: " + str(work_left) + " mm")
                    result.append("Right: " + str(work_right) + " mm")
                    result.append("Bottom: " + str(work_bottom) + " mm")
                    result.append("Top: " + str(work_top) + " mm")
                    result.append("Size: " + str(work_w) + " x " + str(work_h) + " mm")
                    result.append("")
                    
                    # Calculate 2x2 grid positions for views
                    views_w = work_w * 0.65
                    cell_w = views_w / 2
                    cell_h = work_h / 2
                    
                    result.append("=== SUGGESTED VIEWPORT POSITIONS ===")
                    result.append("Cell size: " + str(round(cell_w)) + " x " + str(round(cell_h)) + " mm")
                    result.append("")
                    
                    # Top-left (PLAN)
                    plan_x = work_left + cell_w * 0.5
                    plan_y = work_top - cell_h * 0.5
                    result.append("PLAN (top-left): (" + str(round(plan_x)) + ", " + str(round(plan_y)) + ") mm")
                    
                    # Top-right (SECTION 1)
                    sec1_x = work_left + cell_w * 1.5
                    sec1_y = work_top - cell_h * 0.5
                    result.append("SECTION 1 (top-right): (" + str(round(sec1_x)) + ", " + str(round(sec1_y)) + ") mm")
                    
                    # Bottom-left (SECTION 2)
                    sec2_x = work_left + cell_w * 0.5
                    sec2_y = work_bottom + cell_h * 0.5
                    result.append("SECTION 2 (bottom-left): (" + str(round(sec2_x)) + ", " + str(round(sec2_y)) + ") mm")
                    
                    # Bottom-right (3D)
                    v3d_x = work_left + cell_w * 1.5
                    v3d_y = work_bottom + cell_h * 0.5
                    result.append("3D VIEW (bottom-right): (" + str(round(v3d_x)) + ", " + str(round(v3d_y)) + ") mm")
                    
                    # Schedule (right side)
                    sched_x = work_left + views_w + (work_w - views_w) * 0.5
                    sched_y = work_bottom + work_h * 0.6
                    result.append("SCHEDULE (right): (" + str(round(sched_x)) + ", " + str(round(sched_y)) + ") mm")
                else:
                    result.append("Could not get bounding box")
            else:
                result.append("FamilyInstance but not a title block")
                result.append("Category: " + str(cat.Name if cat else "None"))
        else:
            result.append("Unknown element type")
            result.append("Please select a Viewport or Title Block")

text = chr(10).join(result)
show_dialog("Element Info", text)
OUT = text
# ----------------------------------------

watch_result = Watch(km_documentation_generator)
