# Dynamo graph list_title_blocks.dyn (Dynamo 3.0.0.0)
# author: Dynamo Script Generator
# Lists all available title blocks in the project

# group: List All Title Blocks
# Lists all title block families and types available in the project.
# Use this to find the correct names for TITLE_BLOCK_FAMILY and TITLE_BLOCK_TYPE.
list_title_blocks = Python()  # CPython3
# ---------- list_title_blocks.python (138 lines) ----------
# List all title blocks in project

import clr

try:
    clr.AddReference('RevitAPI')
    clr.AddReference('RevitAPIUI')
    clr.AddReference('RevitServices')
    clr.AddReference('RevitNodes')
    
    from RevitServices.Persistence import DocumentManager
    from Autodesk.Revit.DB import FilteredElementCollector, BuiltInCategory, FamilySymbol, BuiltInParameter, Element
    from Autodesk.Revit.UI import TaskDialog
    
    import Revit
    clr.ImportExtensions(Revit.Elements)
    
    doc = DocumentManager.Instance.CurrentDBDocument
    
    def get_element_name(elem):
        """Try multiple ways to get element name"""
        # Method 1: Direct Name property
        try:
            n = elem.Name
            if n:
                return n
        except:
            pass
        
        # Method 2: SYMBOL_NAME_PARAM
        try:
            p = elem.get_Parameter(BuiltInParameter.SYMBOL_NAME_PARAM)
            if p and p.HasValue:
                return p.AsString()
        except:
            pass
        
        # Method 3: ALL_MODEL_TYPE_NAME
        try:
            p = elem.get_Parameter(BuiltInParameter.ALL_MODEL_TYPE_NAME)
            if p and p.HasValue:
                return p.AsString()
        except:
            pass
        
        # Method 4: Element.Name.GetValue
        try:
            return Element.Name.GetValue(elem)
        except:
            pass
        
        # Method 5: LookupParameter
        try:
            p = elem.LookupParameter("Type Name")
            if p and p.HasValue:
                return p.AsString()
        except:
            pass
        
        try:
            p = elem.LookupParameter("Имя типа")
            if p and p.HasValue:
                return p.AsString()
        except:
            pass
        
        return None
    
    lines = []
    lines.append("ALL TITLE BLOCKS IN PROJECT:")
    lines.append("="*50)
    lines.append("")
    
    collector = FilteredElementCollector(doc).OfCategory(BuiltInCategory.OST_TitleBlocks).OfClass(FamilySymbol)
    
    title_blocks = []
    for tb in collector:
        try:
            family_name = ""
            type_name = ""
            is_active = False
            
            try:
                family_name = tb.Family.Name if tb.Family else "[no family]"
            except:
                family_name = "[error reading family]"
            
            type_name = get_element_name(tb)
            if not type_name:
                type_name = "[ID:" + str(tb.Id.IntegerValue) + "]"
            
            try:
                is_active = tb.IsActive
            except:
                pass
            
            title_blocks.append({
                'family': family_name,
                'type': type_name,
                'active': is_active,
                'id': tb.Id.IntegerValue
            })
        except Exception as ex:
            lines.append("Error reading title block: " + str(ex))
    
    lines.append("Found " + str(len(title_blocks)) + " title block types:")
    lines.append("")
    
    # Group by family
    families = {}
    for tb in title_blocks:
        fam = tb['family']
        if fam not in families:
            families[fam] = []
        families[fam].append(tb)
    
    for fam_name in sorted(families.keys()):
        lines.append("FAMILY: " + fam_name)
        for tb in families[fam_name]:
            active_mark = " [ACTIVE]" if tb['active'] else ""
            lines.append("  TYPE: " + tb['type'] + active_mark)
            lines.append("    ID: " + str(tb['id']))
        lines.append("")
    
    lines.append("="*50)
    lines.append("")
    lines.append("To use a title block, update TITLE_BLOCK_FAMILY and TITLE_BLOCK_TYPE")
    lines.append("in create_km_documentation.dyn with exact names from above.")
    
    result_text = "\n".join(lines)
    TaskDialog.Show("Title Blocks", result_text)
    OUT = result_text

except Exception as e:
    import traceback
    error_msg = "ERROR: " + str(e) + "\n" + traceback.format_exc()
    TaskDialog.Show("Error", error_msg)
    OUT = error_msg
# ----------------------------------------

watch_result = Watch(list_title_blocks)
