# Dynamo graph preview_km_documentation.dyn (Dynamo 3.0.0.0)
# author: Dynamo Script Generator
# Preview what will be created/deleted - NO CHANGES made to the model

# group: Preview - No Changes
# Shows a popup dialog with analysis results.
# No changes are made to the model.
# Run this BEFORE create/delete scripts.
preview_analysis = Python()  # CPython3
# ---------- preview_analysis.python (312 lines) ----------
# Dynamo Script for Revit 2025 - KM Documentation Preview
# Groups elements by actual dimensions from parameters
# Shows which title block will be used

import clr

try:
    clr.AddReference('RevitAPI')
    clr.AddReference('RevitAPIUI')
    clr.AddReference('RevitServices')
    clr.AddReference('RevitNodes')
    
    from RevitServices.Persistence import DocumentManager
    from Autodesk.Revit.DB import FilteredElementCollector, BuiltInCategory, FamilySymbol
    from Autodesk.Revit.DB import ViewSheet, View, ViewSchedule, BuiltInParameter, StorageType
    from Autodesk.Revit.UI import TaskDialog
    
    import Revit
    clr.ImportExtensions(Revit.Elements)
    
    PREFIX = "KM_AUTO_"
    TITLE_BLOCK_FAMILY = "ADSK_ОсновнаяНадпись"
    TITLE_BLOCK_TYPE = "Форма 3"
    doc = DocumentManager.Instance.CurrentDBDocument
    debug_log = []
    
    def get_param_value_str(param):
        try:
            if not param or not param.HasValue:
                return None
            st = param.StorageType
            if st == StorageType.Double:
                return str(round(param.AsDouble() * 304.8, 1))
            elif st == StorageType.String:
                return param.AsString() or None
            elif st == StorageType.Integer:
                return str(param.AsInteger())
            elif st == StorageType.ElementId:
                eid = param.AsElementId()
                if eid.IntegerValue > 0:
                    ref_elem = doc.GetElement(eid)
                    if ref_elem and hasattr(ref_elem, 'Name'):
                        return ref_elem.Name
                return None
            return None
        except:
            return None
    
    def get_all_params(elem):
        result = {}
        try:
            params = elem.GetOrderedParameters()
            for param in params:
                try:
                    name = param.Definition.Name
                    val = get_param_value_str(param)
                    if val:
                        result[name] = val
                except:
                    pass
        except Exception as ex:
            debug_log.append("GetOrderedParams error: " + str(ex))
        return result
    
    def get_type_params(elem):
        result = {}
        try:
            type_id = elem.GetTypeId()
            if type_id.IntegerValue > 0:
                elem_type = doc.GetElement(type_id)
                if elem_type:
                    params = elem_type.GetOrderedParameters()
                    for param in params:
                        try:
                            name = param.Definition.Name
                            val = get_param_value_str(param)
                            if val:
                                result[name] = val
                        except:
                            pass
        except Exception as ex:
            debug_log.append("GetTypeParams error: " + str(ex))
        return result
    
    def get_type_name_safe(elem):
        try:
            type_id = elem.GetTypeId()
            if type_id.IntegerValue <= 0:
                return "NoType"
            elem_type = doc.GetElement(type_id)
            if not elem_type:
                return "TypeNotFound"
            name_parts = []
            try:
                fn = elem_type.FamilyName
                if fn:
                    name_parts.append(fn)
            except:
                pass
            try:
                n = elem_type.Name
                if n:
                    name_parts.append(n)
            except:
                try:
                    p = elem_type.get_Parameter(BuiltInParameter.SYMBOL_NAME_PARAM)
                    if p and p.HasValue:
                        name_parts.append(p.AsString())
                except:
                    pass
            return ": ".join(name_parts) if name_parts else "Type_" + str(type_id.IntegerValue)
        except:
            return "Unknown"
    
    def get_element_size_key(elem):
        try:
            inst_params = get_all_params(elem)
            type_params = get_type_params(elem)
            
            type_name = get_type_name_safe(elem)
            
            size_parts = []
            length = inst_params.get('Длина') or inst_params.get('Length') or inst_params.get('ADSK_Длина балки истинная') or inst_params.get('Фактическая длина')
            if length:
                size_parts.append("L=" + str(length))
            
            section = type_params.get('Сечение') or type_params.get('Section') or type_params.get('Профиль') or type_params.get('Profile')
            if section:
                size_parts.append(str(section))
            
            h = type_params.get('h') or inst_params.get('h')
            b = type_params.get('b') or inst_params.get('b')
            if h:
                size_parts.append("h=" + str(h))
            if b:
                size_parts.append("b=" + str(b))
            
            if size_parts:
                return type_name + " | " + ", ".join(size_parts)
            return type_name
        except Exception as ex:
            debug_log.append("size_key err: " + str(ex))
            return "Error"
    
    def get_km_elements():
        categories = [
            BuiltInCategory.OST_StructuralFraming,
            BuiltInCategory.OST_StructuralColumns,
            BuiltInCategory.OST_StructuralFoundation
        ]
        elements = []
        for cat in categories:
            try:
                collector = FilteredElementCollector(doc).OfCategory(cat).WhereElementIsNotElementType()
                elems = collector.ToElements()
                for e in elems:
                    elements.append(e)
            except:
                pass
        return elements
    
    def get_unique_sizes(elements):
        size_dict = {}
        for elem in elements:
            key = get_element_size_key(elem)
            if key not in size_dict:
                size_dict[key] = 0
            size_dict[key] = size_dict[key] + 1
        return size_dict
    
    def get_existing_prefixed():
        sheets = []
        views = []
        schedules = []
        try:
            for s in FilteredElementCollector(doc).OfClass(ViewSheet).ToElements():
                if s.Name.startswith(PREFIX) or s.SheetNumber.startswith(PREFIX):
                    sheets.append(s.SheetNumber + " - " + s.Name)
        except:
            pass
        try:
            for v in FilteredElementCollector(doc).OfClass(View).ToElements():
                if v.Name.startswith(PREFIX) and not v.IsTemplate:
                    views.append(v.Name)
        except:
            pass
        try:
            for sc in FilteredElementCollector(doc).OfClass(ViewSchedule).ToElements():
                if sc.Name.startswith(PREFIX):
                    schedules.append(sc.Name)
        except:
            pass
        return sheets, views, schedules
    
    def get_specific_title_block(family_name, type_name):
        """Find title block by family name and type name"""
        collector = FilteredElementCollector(doc).OfCategory(BuiltInCategory.OST_TitleBlocks).OfClass(FamilySymbol)
        found_tb = None
        fallback_tb = None
        all_title_blocks = []
        
        for tb in collector:
            try:
                tb_family = tb.Family.Name if tb.Family else ""
                tb_type = tb.Name if hasattr(tb, 'Name') else ""
                all_title_blocks.append(tb_family + ": " + tb_type)
                
                # Exact match
                if tb_family == family_name and tb_type == type_name:
                    found_tb = tb
                    break
                
                # Partial match (contains)
                if family_name in tb_family:
                    if type_name in tb_type:
                        found_tb = tb
                        break
                    elif fallback_tb is None:
                        fallback_tb = tb
                
                # First available as fallback
                if fallback_tb is None:
                    fallback_tb = tb
            except:
                pass
        
        if found_tb:
            return found_tb, all_title_blocks, "FOUND"
        elif fallback_tb:
            return fallback_tb, all_title_blocks, "FALLBACK"
        return None, all_title_blocks, "NOT_FOUND"
    
    km_elements = get_km_elements()
    size_dict = get_unique_sizes(km_elements)
    existing_sheets, existing_views, existing_schedules = get_existing_prefixed()
    
    # Find specific title block
    title_block, all_tb_list, tb_status = get_specific_title_block(TITLE_BLOCK_FAMILY, TITLE_BLOCK_TYPE)
    if title_block:
        try:
            title_block_name = title_block.Family.Name + ": " + title_block.Name
        except:
            title_block_name = "Unknown"
    else:
        title_block_name = None
    
    element_summary = {}
    for elem in km_elements:
        try:
            cat_name = elem.Category.Name if elem.Category else "Unknown"
            if cat_name not in element_summary:
                element_summary[cat_name] = 0
            element_summary[cat_name] = element_summary[cat_name] + 1
        except:
            pass
    
    sample_params_list = []
    if len(km_elements) > 0:
        all_p = get_all_params(km_elements[0])
        type_p = get_type_params(km_elements[0])
        for k, v in list(type_p.items())[:15]:
            sample_params_list.append("[T] " + k + "=" + v)
        for k, v in list(all_p.items())[:15]:
            sample_params_list.append("[I] " + k + "=" + v)
    
    lines = []
    lines.append("PREFIX: " + PREFIX)
    lines.append("")
    lines.append("TITLE BLOCK:")
    lines.append("  Looking for: " + TITLE_BLOCK_FAMILY + ": " + TITLE_BLOCK_TYPE)
    if title_block_name:
        lines.append("  Will use: " + title_block_name + " [" + tb_status + "]")
    else:
        lines.append("  WARNING: No title block found!")
    lines.append("  Available (" + str(len(all_tb_list)) + "):")
    for tb_name in all_tb_list[:5]:
        lines.append("    - " + tb_name)
    if len(all_tb_list) > 5:
        lines.append("    ... +" + str(len(all_tb_list) - 5) + " more")
    lines.append("")
    lines.append("KM ELEMENTS: " + str(len(km_elements)) + " total, " + str(len(size_dict)) + " unique sizes")
    for cat_name, count in element_summary.items():
        lines.append("  " + cat_name + ": " + str(count))
    lines.append("")
    lines.append("UNIQUE SIZES:")
    sorted_sizes = sorted(size_dict.items(), key=lambda x: -x[1])
    for size_key, count in sorted_sizes[:40]:
        lines.append("  - " + size_key + " (" + str(count) + ")")
    if len(sorted_sizes) > 40:
        lines.append("  ... +" + str(len(sorted_sizes) - 40) + " more")
    lines.append("")
    lines.append("SAMPLE PARAMS ([T]=type, [I]=instance):")
    for p in sample_params_list:
        lines.append("  " + p)
    lines.append("")
    if debug_log:
        lines.append("DEBUG:")
        for d in debug_log[:10]:
            lines.append("  " + d)
        lines.append("")
    lines.append("WILL CREATE: " + str(6 + len(size_dict)) + " sheets")
    lines.append("EXISTING: " + str(len(existing_sheets)) + " sheets, " + str(len(existing_views)) + " views")
    
    result_text = "\n".join(lines)
    TaskDialog.Show("KM Preview", result_text)
    OUT = result_text

except Exception as e:
    import traceback
    error_msg = "ERROR: " + str(e) + "\n" + traceback.format_exc()
    TaskDialog.Show("Error", error_msg)
    OUT = error_msg
# ----------------------------------------

watch_result = Watch(preview_analysis)
